# Grasshopper definition Curtain Walls_Native.ghx (Grasshopper 1.0.7)
# plug-ins: Rhino.Inside for Autodesk Revit

model = ModelCategoriesPicker()
model_2 = ModelCategoriesPicker()
model_3 = ModelCategoriesPicker()
# PARTS (TYPE, INSTANCE)
model_4 = ModelCategoriesPicker()
model_5 = ModelCategoriesPicker()
model_6 = ModelCategoriesPicker()
# CURTAIN WALLS AND TYPES
wall_system_family = WallSystemFamily({"Basic": 0, "Curtain": 1, "Stacked": 2}, selected="Curtain")
model_7 = ModelCategoriesPicker()
# CURTAIN SYSTEMS AND TYPES
model_8 = ModelCategoriesPicker()
walls = DocumentWalls(WallSystemFamily=wall_system_family)
bycategory = ElementCategoryFilter(Categories=model, Inverted=False)
bycategory_2 = ElementCategoryFilter(Categories=model_2, Inverted=False)
bycategory_3 = ElementCategoryFilter(Categories=model_3, Inverted=False)
bycategory_4 = ElementCategoryFilter(Categories=model_4, Inverted=False)
bycategory_5 = ElementCategoryFilter(Categories=model_5, Inverted=False)
bycategory_6 = ElementCategoryFilter(Categories=model_6, Inverted=False)
bycategory_7 = ElementCategoryFilter(Categories=model_7, Inverted=False)
bycategory_8 = ElementCategoryFilter(Categories=model_8, Inverted=False)
elements = DocumentElements(Filter=bycategory)
elements_2 = DocumentElements(Filter=bycategory_2)
elements_3 = DocumentElements(Filter=bycategory_3)
elementtypes = DocumentElementTypes(Filter=bycategory_4)
elementtypes_2 = DocumentElementTypes(Filter=bycategory_5)
elementtypes_3 = DocumentElementTypes(Filter=bycategory_6)
identity = ElementIdentity(Element=walls)  # -> Category, Type, Name
panel = Panel(walls)
elements_4 = DocumentElements(Filter=bycategory_7)
elementtypes_4 = DocumentElementTypes(Filter=bycategory_8)
panel_2 = Panel(elementtypes)
panel_3 = Panel(elementtypes_2)
panel_4 = Panel(elementtypes_3)
panel_5 = Panel(elements)
panel_6 = Panel(elements_2)
panel_7 = Panel(elements_3)
panel_8 = Panel(identity.Type)
panel_9 = Panel(elementtypes_4)
panel_10 = Panel(elements_4)
wall_system_family_2 = WallSystemFamily({"Basic": 0, "Curtain": 1, "Stacked": 2}, selected="Curtain")
wall_system_family_3 = WallSystemFamily({"Basic": 0, "Curtain": 1, "Stacked": 2}, selected="Curtain")
# GRID CELLS
wall_system_family_4 = WallSystemFamily({"Basic": 0, "Curtain": 1, "Stacked": 2}, selected="Curtain")
# INSTANCES
wall_system_family_5 = WallSystemFamily({"Basic": 0, "Curtain": 1, "Stacked": 2}, selected="Curtain")
wall_system_family_6 = WallSystemFamily({"Basic": 0, "Curtain": 1, "Stacked": 2}, selected="Curtain")
wall_system_family_7 = WallSystemFamily({"Basic": 0, "Curtain": 1, "Stacked": 2}, selected="Curtain")
# CURTAIN GRID
wall_system_family_8 = WallSystemFamily({"Basic": 0, "Curtain": 1, "Stacked": 2}, selected="Curtain")
wall_system_family_9 = WallSystemFamily({"Basic": 0, "Curtain": 1, "Stacked": 2}, selected="Curtain")
wall_system_family_10 = WallSystemFamily({"Basic": 0, "Curtain": 1, "Stacked": 2}, selected="Curtain")
walls_2 = DocumentWalls(WallSystemFamily=wall_system_family_2)
level_of_detail = LevelOfDetail({"Coarse": 1, "Medium": 2, "Fine": 3}, selected="Fine")
walls_3 = DocumentWalls(WallSystemFamily=wall_system_family_3)
walls_4 = DocumentWalls(WallSystemFamily=wall_system_family_4)
walls_5 = DocumentWalls(WallSystemFamily=wall_system_family_6)
walls_6 = DocumentWalls(WallSystemFamily=wall_system_family_7)
walls_7 = DocumentWalls(WallSystemFamily=wall_system_family_8)
walls_8 = DocumentWalls(WallSystemFamily=wall_system_family_5)
walls_9 = DocumentWalls(WallSystemFamily=wall_system_family_9)
identity_2 = ElementIdentity(Element=walls_2)  # -> Category, Type, Name
walls_10 = DocumentWalls(WallSystemFamily=wall_system_family_10)
analyze_curtain_wall = AnalyzeCurtainWall(CurtainWall=walls_3)  # -> CurtainGrid, HostWall
analyze_curtain_wall_2 = AnalyzeCurtainWall(CurtainWall=walls_4)  # -> CurtainGrid, HostWall
analyze_curtain_wall_3 = AnalyzeCurtainWall(CurtainWall=walls_9)  # -> CurtainGrid, HostWall
# CURTAIN WALLS
# TYPES
a_cwt = AnalyzeCurtainWallType(CurtainWallType=identity_2.Type)  # -> WallFunction, AutomaticallyEmbed, CurtainPanelType, CurtainGridJoinCondition, VerticalGridLayoutUAxis, VerticalGridSpacingUAxis, VerticalGridAdjustForMullionSizeUAxis, HorizontalGridLayoutVAxis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
geometry = ElementGeometry(Element=walls_8, DetailLevel=level_of_detail)
ebg = ElementBoundingGeometry(Element=walls_5)
analyze_curtain_wall_4 = AnalyzeCurtainWall(CurtainWall=walls_6)  # -> CurtainGrid, HostWall
analyze_curtain_wall_5 = AnalyzeCurtainWall(CurtainWall=walls_7)  # -> CurtainGrid, HostWall
analyze_curtain_wall_6 = AnalyzeCurtainWall(CurtainWall=walls_10)  # -> CurtainGrid, HostWall
analyze_curtain_grid = AnalyzeCurtainGrid(CurtainGrid=analyze_curtain_wall.CurtainGrid)  # -> CurtainGridCells, CurtainGridMullions, CurtainGridPanels, CurtainGridLinesAlongUAxis, CurtainGridAngleUAxisGrid1, CurtainGridAlignmentTypeUAxisGrid1, CurtainGridOffsetUAxisGrid1, CurtainGridLinesAlongVAxis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
analyze_curtain_grid_2 = AnalyzeCurtainGrid(CurtainGrid=analyze_curtain_wall_2.CurtainGrid)  # -> CurtainGridCells, CurtainGridMullions, CurtainGridPanels, CurtainGridLinesAlongUAxis, CurtainGridAngleUAxisGrid1, CurtainGridAlignmentTypeUAxisGrid1, CurtainGridOffsetUAxisGrid1, CurtainGridLinesAlongVAxis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
analyze_curtain_grid_3 = AnalyzeCurtainGrid(CurtainGrid=analyze_curtain_wall_3.CurtainGrid)  # -> CurtainGridCells, CurtainGridMullions, CurtainGridPanels, CurtainGridLinesAlongUAxis, CurtainGridAngleUAxisGrid1, CurtainGridAlignmentTypeUAxisGrid1, CurtainGridOffsetUAxisGrid1, CurtainGridLinesAlongVAxis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
analyze_curtain_grid_4 = AnalyzeCurtainGrid(CurtainGrid=analyze_curtain_wall_6.CurtainGrid)  # -> CurtainGridCells, CurtainGridMullions, CurtainGridPanels, CurtainGridLinesAlongUAxis, CurtainGridAngleUAxisGrid1, CurtainGridAlignmentTypeUAxisGrid1, CurtainGridOffsetUAxisGrid1, CurtainGridLinesAlongVAxis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
panel_11 = Panel(geometry)
bounding_geometry = Panel(ebg)
host_wall = Panel(analyze_curtain_wall_5.HostWall)
curtain_grid = Panel(analyze_curtain_wall_4.CurtainGrid)
analyze_curtain_grid_cell = AnalyzeCurtainGridCell(CurtainGridCell=analyze_curtain_grid_3.CurtainGridCells)  # -> Curves, PlanarizedCurves
analyze_curtain_grid_cell_2 = AnalyzeCurtainGridCell(CurtainGridCell=analyze_curtain_grid_4.CurtainGridCells)  # -> Curves, PlanarizedCurves
path_mapper = PathMapper(
    [a_cwt.VerticalGridLayoutUAxis, a_cwt.VerticalGridSpacingUAxis, a_cwt.VerticalGridAdjustForMullionSizeUAxis],
    source="{A;B}(i)",
    target="{A;B;i}")
path_mapper_2 = PathMapper(
    [a_cwt.HorizontalGridLayoutVAxis, a_cwt.HorizontalGridSpacingVAxis, a_cwt.HorizontalGridAdjustForMullionSizeVAxis],
    source="{A;B}(i)",
    target="{A;B;i}")
path_mapper_3 = PathMapper(
    [a_cwt.VerticalInteriorMullionTypeUAxis, a_cwt.VerticalStartMullionTypeUAxisBorder1, a_cwt.VerticalEndMullionTypeUAxisBorder2],
    source="{A;B}(i)",
    target="{A;B;i}")
path_mapper_4 = PathMapper(
    [a_cwt.HorizontalInteriorMullionTypeVAxis, a_cwt.HorizontalBottomMullionTypeVAxisBorder1, a_cwt.HorizontalTopMullionTypeVAxisBorder2],
    source="{A;B}(i)",
    target="{A;B;i}")
wall_function = Panel(a_cwt.WallFunction)
automatically_embed = Panel(a_cwt.AutomaticallyEmbed)
curtain_panel_type = Panel(a_cwt.CurtainPanelType)
curtain_join_condition = Panel(a_cwt.CurtainGridJoinCondition)
u_grid_lines = Panel(analyze_curtain_grid.CurtainGridLinesAlongUAxis)
grid_mullions = Panel(analyze_curtain_grid.CurtainGridMullions)
grid_inserts = Panel(analyze_curtain_grid.CurtainGridPanels)
v_grid_lines = Panel(analyze_curtain_grid.CurtainGridLinesAlongVAxis)
grid_cells = Panel(analyze_curtain_grid.CurtainGridCells)
path_mapper_5 = PathMapper(
    [analyze_curtain_grid.CurtainGridAngleUAxisGrid1, analyze_curtain_grid.CurtainGridAlignmentTypeUAxisGrid1, analyze_curtain_grid.CurtainGridOffsetUAxisGrid1],
    source="{A;B}(i)",
    target="{A;B;i}")
path_mapper_6 = PathMapper(
    [analyze_curtain_grid.CurtainGridAngleVAxisGrid2, analyze_curtain_grid.CurtainGridAlignmentTypeVAxisGrid2, analyze_curtain_grid.CurtainGridOffsetVAxisGrid2],
    source="{A;B}(i)",
    target="{A;B;i}")
cell_curve = Panel(analyze_curtain_grid_cell.Curves)
grid_cell_geom = CustomPreview(Geometry=analyze_curtain_grid_cell.Curves, Material=ColourSwatch(SwatchColor=RGB(255, 255, 255)))
lng = ListLength(List=analyze_curtain_grid_2.CurtainGridCells)
cell_count = Panel(lng)
u_grid_info = Panel(path_mapper)
v_grid_info = Panel(path_mapper_2)
u_mullion_info = Panel(path_mapper_3)
v_mullion_info = Panel(path_mapper_4)
center_planes = BoundarySurfaces(Edges=analyze_curtain_grid_cell_2.PlanarizedCurves, UseTasks=False)
cell_panel_curve = Panel(analyze_curtain_grid_cell_2.PlanarizedCurves)
u_grid_info_2 = Panel(path_mapper_5)
v_grid_info_2 = Panel(path_mapper_6)
wf = WallFunction({"Interior": 0, "Exterior": 1, "Foundation": 2, "Retaining": 3, "Soffit": 4, "Core-Shaft": 5}, selected="Interior")
analyze_curtain_grid_cell_3 = AnalyzeCurtainGridCell(CurtainGridCell=analyze_curtain_grid_2.CurtainGridCells)  # -> Curves, PlanarizedCurves
amoments = AreaMoments(Geometry=center_planes)  # -> Area, Centroid, Inertia, InertiaError, Secondary, SecondaryError, Gyration
cell_plane = CustomPreview(Geometry=center_planes, Material=ColourSwatch(SwatchColor=RGBA(219, 0, 255, 23)))
pshift = ShiftPaths(Data=amoments.Centroid, Offset=-1)
cgjc = CurtainGridJoinCondition({"Not Defined": 0, "Vertical Grid Continuous": 1, "Horizontal Grid Continuous": 2, "Border & Vertical Grid Continuous": 3, "Border & Horizontal Grid Continuous": 4}, selected="Not Defined")
cell_curve_2 = Panel(analyze_curtain_grid_cell_3.Curves)
cell_panel_curve_2 = Panel(analyze_curtain_grid_cell_3.PlanarizedCurves)
points = PointList(Points=pshift)
# = Layout
# = Spacing
# = Adjust for Mullion Size
# = Inteiror Mullion Type
# = Start Mullion Type (Border 1)
# = End Mullion Type (Border 2)
# = Inteiror Mullion Type
# = Bottom Mullion Type (Border 1)
# = Top Mullion Type (Border 2)
cgl = CurtainGridLayout({"None": 0, "Fixed Distance": 1, "Fixed Number": 2, "Maximum Spacing": 3, "Minimum Spacing": 4}, selected="None")
# = Layout
# = Spacing
# = Adjust for Mullion Size
cgl_2 = CurtainGridLayout({"None": 0, "Fixed Distance": 1, "Fixed Number": 2, "Maximum Spacing": 3, "Minimum Spacing": 4}, selected="None")
# = Grid Angle
# = Grid Justification
# = Grid Offset
cgat = CurtainGridAlignType({"No Justify": 0, "Beginning": 1, "Center": 2, "End": 3}, selected="No Justify")
# = Grid Angle
# = Grid Justification
# = Grid Offset
cgat_2 = CurtainGridAlignType({"No Justify": 0, "Beginning": 1, "Center": 2, "End": 3}, selected="No Justify")
wall_system_family_11 = WallSystemFamily({"Basic": 0, "Curtain": 1, "Stacked": 2}, selected="Curtain")
wall_system_family_12 = WallSystemFamily({"Basic": 0, "Curtain": 1, "Stacked": 2}, selected="Curtain")
# MULLIONS
wall_system_family_13 = WallSystemFamily({"Basic": 0, "Curtain": 1, "Stacked": 2}, selected="Curtain")
wall_system_family_14 = WallSystemFamily({"Basic": 0, "Curtain": 1, "Stacked": 2}, selected="Curtain")
# TYPES
wall_system_family_15 = WallSystemFamily({"Basic": 0, "Curtain": 1, "Stacked": 2}, selected="Curtain")
wall_system_family_16 = WallSystemFamily({"Basic": 0, "Curtain": 1, "Stacked": 2}, selected="Curtain")
walls_11 = DocumentWalls(WallSystemFamily=wall_system_family_11)
walls_12 = DocumentWalls(WallSystemFamily=wall_system_family_12)
walls_13 = DocumentWalls(WallSystemFamily=wall_system_family_13)
walls_14 = DocumentWalls(WallSystemFamily=wall_system_family_14)
walls_15 = DocumentWalls(WallSystemFamily=wall_system_family_15)
walls_16 = DocumentWalls(WallSystemFamily=wall_system_family_16)
analyze_curtain_wall_7 = AnalyzeCurtainWall(CurtainWall=walls_11)  # -> CurtainGrid, HostWall
analyze_curtain_wall_8 = AnalyzeCurtainWall(CurtainWall=walls_12)  # -> CurtainGrid, HostWall
analyze_curtain_wall_9 = AnalyzeCurtainWall(CurtainWall=walls_13)  # -> CurtainGrid, HostWall
analyze_curtain_wall_10 = AnalyzeCurtainWall(CurtainWall=walls_14)  # -> CurtainGrid, HostWall
analyze_curtain_wall_11 = AnalyzeCurtainWall(CurtainWall=walls_15)  # -> CurtainGrid, HostWall
analyze_curtain_wall_12 = AnalyzeCurtainWall(CurtainWall=walls_16)  # -> CurtainGrid, HostWall
analyze_curtain_grid_5 = AnalyzeCurtainGrid(CurtainGrid=analyze_curtain_wall_7.CurtainGrid)  # -> CurtainGridCells, CurtainGridMullions, CurtainGridPanels, CurtainGridLinesAlongUAxis, CurtainGridAngleUAxisGrid1, CurtainGridAlignmentTypeUAxisGrid1, CurtainGridOffsetUAxisGrid1, CurtainGridLinesAlongVAxis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
analyze_curtain_grid_6 = AnalyzeCurtainGrid(CurtainGrid=analyze_curtain_wall_8.CurtainGrid)  # -> CurtainGridCells, CurtainGridMullions, CurtainGridPanels, CurtainGridLinesAlongUAxis, CurtainGridAngleUAxisGrid1, CurtainGridAlignmentTypeUAxisGrid1, CurtainGridOffsetUAxisGrid1, CurtainGridLinesAlongVAxis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
analyze_curtain_grid_7 = AnalyzeCurtainGrid(CurtainGrid=analyze_curtain_wall_9.CurtainGrid)  # -> CurtainGridCells, CurtainGridMullions, CurtainGridPanels, CurtainGridLinesAlongUAxis, CurtainGridAngleUAxisGrid1, CurtainGridAlignmentTypeUAxisGrid1, CurtainGridOffsetUAxisGrid1, CurtainGridLinesAlongVAxis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
analyze_curtain_grid_8 = AnalyzeCurtainGrid(CurtainGrid=analyze_curtain_wall_10.CurtainGrid)  # -> CurtainGridCells, CurtainGridMullions, CurtainGridPanels, CurtainGridLinesAlongUAxis, CurtainGridAngleUAxisGrid1, CurtainGridAlignmentTypeUAxisGrid1, CurtainGridOffsetUAxisGrid1, CurtainGridLinesAlongVAxis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
analyze_curtain_grid_9 = AnalyzeCurtainGrid(CurtainGrid=analyze_curtain_wall_11.CurtainGrid)  # -> CurtainGridCells, CurtainGridMullions, CurtainGridPanels, CurtainGridLinesAlongUAxis, CurtainGridAngleUAxisGrid1, CurtainGridAlignmentTypeUAxisGrid1, CurtainGridOffsetUAxisGrid1, CurtainGridLinesAlongVAxis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
analyze_curtain_grid_10 = AnalyzeCurtainGrid(CurtainGrid=analyze_curtain_wall_12.CurtainGrid)  # -> CurtainGridCells, CurtainGridMullions, CurtainGridPanels, CurtainGridLinesAlongUAxis, CurtainGridAngleUAxisGrid1, CurtainGridAlignmentTypeUAxisGrid1, CurtainGridOffsetUAxisGrid1, CurtainGridLinesAlongVAxis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
a_cgm = AnalyzeCurtainGridMullion(CurtainGridMullion=analyze_curtain_grid_6.CurtainGridMullions)  # -> CurtainGridMullionType, CurtainGridMullionAxisCurve, CurtainGridMullionBasePoint, Locked, IsLockable
crv = Curve(analyze_curtain_grid_7.CurtainGridMullions)
a_cgm_2 = AnalyzeCurtainGridMullion(CurtainGridMullion=analyze_curtain_grid_8.CurtainGridMullions)  # -> CurtainGridMullionType, CurtainGridMullionAxisCurve, CurtainGridMullionBasePoint, Locked, IsLockable
geometry_2 = ElementGeometry(Element=analyze_curtain_grid_5.CurtainGridMullions)
a_cgm_3 = AnalyzeCurtainGridMullion(CurtainGridMullion=analyze_curtain_grid_9.CurtainGridMullions)  # -> CurtainGridMullionType, CurtainGridMullionAxisCurve, CurtainGridMullionBasePoint, Locked, IsLockable
a_cgm_4 = AnalyzeCurtainGridMullion(CurtainGridMullion=analyze_curtain_grid_10.CurtainGridMullions)  # -> CurtainGridMullionType, CurtainGridMullionAxisCurve, CurtainGridMullionBasePoint, Locked, IsLockable
mullion_base_curves = Panel(crv)
len = Length(Curve=crv)
grid_mullion_geom = CustomPreview(Geometry=geometry_2, Material=ColourSwatch(SwatchColor=RGBA(0, 112, 255, 101)))
a_cgmt = AnalyzeCurtainGridMullionType(CurtainGridMullionType=a_cgm_3.CurtainGridMullionType)  # -> MullionSystemFamily, Angle, Offset, Profile, Position, CornerMullion, Thickness, Depth1, Depth2, Radius
a_cgmt_2 = AnalyzeCurtainGridMullionType(CurtainGridMullionType=a_cgm_4.CurtainGridMullionType)  # -> MullionSystemFamily, Angle, Offset, Profile, Position, CornerMullion, Thickness, Depth1, Depth2, Radius
bool = Boolean(invert(len))
path_mapper_7 = PathMapper([a_cgm_2.CurtainGridMullionBasePoint, a_cgm_2.Locked, a_cgm_2.IsLockable], source="{A;B;C}(i)", target="{A;B;C;i}")
type = Panel(a_cgm_2.CurtainGridMullionType)
base_curve = Panel(a_cgm_2.CurtainGridMullionAxisCurve)
mullion_base_curves_2 = Panel(a_cgm.CurtainGridMullionAxisCurve)
midpt = CurveMiddle(Curve=a_cgm.CurtainGridMullionAxisCurve)
cull = CullPattern(List=len, CullPattern=bool)
points_2 = PointList(Points=midpt)
path_mapper_8 = PathMapper(
    [a_cgmt.MullionSystemFamily, a_cgmt.Angle, a_cgmt.Offset, a_cgmt.Profile, a_cgmt.Position, a_cgmt.CornerMullion, a_cgmt.Thickness, a_cgmt.Depth1, a_cgmt.Depth2, a_cgmt.Radius],
    source="{A;B;C}(i)",
    target="{A;B;C;i}")
mullion_base_curve_length = Panel(cull)
cmsf = CurtainMullionSystemFamily({"Unknown": -1, "Rectangular": 0, "Circular": 1, "L Corner": 2, "Trapezoid Corner": 3, "Quad Corner": 4, "V Corner": 5}, selected="L Corner")
# = Base Point
# = Locked?
# = Lockable?
mullion_info = Panel(path_mapper_7)
equals = Equality(FirstNumber=a_cgmt_2.MullionSystemFamily, SecondNumber=cmsf)  # -> Equality, Inequality
mullion_type_properties = Panel(path_mapper_8)
cull_2 = CullPattern(List=analyze_curtain_grid_10.CurtainGridMullions, CullPattern=equals.Equality)
panel_12 = Panel(cull_2)
# = System Family
# = Angle
# = Offset
# = Profile
# = Position
# = Corner Mullion
# = Thickness
# = Dimension 1
# = Dimension 2
# = Radius
cmsf_2 = CurtainMullionSystemFamily({"Unknown": -1, "Rectangular": 0, "Circular": 1, "L Corner": 2, "Trapezoid Corner": 3, "Quad Corner": 4, "V Corner": 5}, selected="Unknown")
cmp = CurtainMullionPosition({"Parallel to Ground": 0, "Perpendicular to Face": 1}, selected="Parallel to Ground")
# PANELS
wall_system_family_17 = WallSystemFamily({"Basic": 0, "Curtain": 1, "Stacked": 2}, selected="Curtain")
wall_system_family_18 = WallSystemFamily({"Basic": 0, "Curtain": 1, "Stacked": 2}, selected="Curtain")
wall_system_family_19 = WallSystemFamily({"Basic": 0, "Curtain": 1, "Stacked": 2}, selected="Curtain")
# TYPES
wall_system_family_20 = WallSystemFamily({"Basic": 0, "Curtain": 1, "Stacked": 2}, selected="Curtain")
wall_system_family_21 = WallSystemFamily({"Basic": 0, "Curtain": 1, "Stacked": 2}, selected="Curtain")
wall_system_family_22 = WallSystemFamily({"Basic": 0, "Curtain": 1, "Stacked": 2}, selected="Curtain")
walls_17 = DocumentWalls(WallSystemFamily=wall_system_family_17)
walls_18 = DocumentWalls(WallSystemFamily=wall_system_family_18)
walls_19 = DocumentWalls(WallSystemFamily=wall_system_family_19)
walls_20 = DocumentWalls(WallSystemFamily=wall_system_family_20)
walls_21 = DocumentWalls(WallSystemFamily=wall_system_family_21)
walls_22 = DocumentWalls(WallSystemFamily=wall_system_family_22)
analyze_curtain_wall_13 = AnalyzeCurtainWall(CurtainWall=walls_17)  # -> CurtainGrid, HostWall
analyze_curtain_wall_14 = AnalyzeCurtainWall(CurtainWall=walls_18)  # -> CurtainGrid, HostWall
analyze_curtain_wall_15 = AnalyzeCurtainWall(CurtainWall=walls_19)  # -> CurtainGrid, HostWall
analyze_curtain_wall_16 = AnalyzeCurtainWall(CurtainWall=walls_20)  # -> CurtainGrid, HostWall
analyze_curtain_wall_17 = AnalyzeCurtainWall(CurtainWall=walls_21)  # -> CurtainGrid, HostWall
analyze_curtain_wall_18 = AnalyzeCurtainWall(CurtainWall=walls_22)  # -> CurtainGrid, HostWall
model_9 = ModelCategoriesPicker()
analyze_curtain_grid_11 = AnalyzeCurtainGrid(CurtainGrid=analyze_curtain_wall_13.CurtainGrid)  # -> CurtainGridCells, CurtainGridMullions, CurtainGridPanels, CurtainGridLinesAlongUAxis, CurtainGridAngleUAxisGrid1, CurtainGridAlignmentTypeUAxisGrid1, CurtainGridOffsetUAxisGrid1, CurtainGridLinesAlongVAxis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
# CURTAIN SYSTEMS
model_10 = ModelCategoriesPicker()
analyze_curtain_grid_12 = AnalyzeCurtainGrid(CurtainGrid=analyze_curtain_wall_14.CurtainGrid)  # -> CurtainGridCells, CurtainGridMullions, CurtainGridPanels, CurtainGridLinesAlongUAxis, CurtainGridAngleUAxisGrid1, CurtainGridAlignmentTypeUAxisGrid1, CurtainGridOffsetUAxisGrid1, CurtainGridLinesAlongVAxis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
analyze_curtain_grid_13 = AnalyzeCurtainGrid(CurtainGrid=analyze_curtain_wall_15.CurtainGrid)  # -> CurtainGridCells, CurtainGridMullions, CurtainGridPanels, CurtainGridLinesAlongUAxis, CurtainGridAngleUAxisGrid1, CurtainGridAlignmentTypeUAxisGrid1, CurtainGridOffsetUAxisGrid1, CurtainGridLinesAlongVAxis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
analyze_curtain_grid_14 = AnalyzeCurtainGrid(CurtainGrid=analyze_curtain_wall_16.CurtainGrid)  # -> CurtainGridCells, CurtainGridMullions, CurtainGridPanels, CurtainGridLinesAlongUAxis, CurtainGridAngleUAxisGrid1, CurtainGridAlignmentTypeUAxisGrid1, CurtainGridOffsetUAxisGrid1, CurtainGridLinesAlongVAxis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
analyze_curtain_grid_15 = AnalyzeCurtainGrid(CurtainGrid=analyze_curtain_wall_17.CurtainGrid)  # -> CurtainGridCells, CurtainGridMullions, CurtainGridPanels, CurtainGridLinesAlongUAxis, CurtainGridAngleUAxisGrid1, CurtainGridAlignmentTypeUAxisGrid1, CurtainGridOffsetUAxisGrid1, CurtainGridLinesAlongVAxis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
model_11 = ModelCategoriesPicker()
analyze_curtain_grid_16 = AnalyzeCurtainGrid(CurtainGrid=analyze_curtain_wall_18.CurtainGrid)  # -> CurtainGridCells, CurtainGridMullions, CurtainGridPanels, CurtainGridLinesAlongUAxis, CurtainGridAngleUAxisGrid1, CurtainGridAlignmentTypeUAxisGrid1, CurtainGridOffsetUAxisGrid1, CurtainGridLinesAlongVAxis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
panel_13 = Panel(analyze_curtain_grid_12.CurtainGridPanels)
a_cgp = AnalyzeCurtainGridPanel(CurtainGridPanel=analyze_curtain_grid_15.CurtainGridPanels)  # -> HostPanel, CurtainGridPanelSymbol, CurtainGridPanelBasePoint, CurtainGridPanelOrientationVector, IsLockable, PanelWidth, PanelHeight
a_cgp_2 = AnalyzeCurtainGridPanel(CurtainGridPanel=analyze_curtain_grid_13.CurtainGridPanels)  # -> HostPanel, CurtainGridPanelSymbol, CurtainGridPanelBasePoint, CurtainGridPanelOrientationVector, IsLockable, PanelWidth, PanelHeight
geometry_3 = ElementGeometry(Element=analyze_curtain_grid_11.CurtainGridPanels)
a_cgp_3 = AnalyzeCurtainGridPanel(CurtainGridPanel=analyze_curtain_grid_16.CurtainGridPanels)  # -> HostPanel, CurtainGridPanelSymbol, CurtainGridPanelBasePoint, CurtainGridPanelOrientationVector, IsLockable, PanelWidth, PanelHeight
bycategory_9 = ElementCategoryFilter(Categories=model_9, Inverted=False)
a_cgp_4 = AnalyzeCurtainGridPanel(CurtainGridPanel=analyze_curtain_grid_14.CurtainGridPanels)  # -> HostPanel, CurtainGridPanelSymbol, CurtainGridPanelBasePoint, CurtainGridPanelOrientationVector, IsLockable, PanelWidth, PanelHeight
bycategory_10 = ElementCategoryFilter(Categories=model_10, Inverted=False)
bycategory_11 = ElementCategoryFilter(Categories=model_11, Inverted=False)
panel_14 = Panel(a_cgp.CurtainGridPanelSymbol)
elements_5 = DocumentElements(Filter=bycategory_9)
a_cgpt = AnalyzeCurtainGridPanelType(CurtainGridPanelType=a_cgp_3.CurtainGridPanelSymbol)  # -> PanelSystemFamily, Offset, Thickness
grid_insert_geom = CustomPreview(Geometry=geometry_3, Material=ColourSwatch(SwatchColor=RGBA(219, 0, 255, 23)))
elements_6 = DocumentElements(Filter=bycategory_10)
geometry_4 = ElementGeometry(Element=analyze_curtain_grid_14.CurtainGridPanels)
elementtypes_5 = DocumentElementTypes(Filter=bycategory_11)
host_panel = Panel(a_cgp_2.HostPanel)
panel_base_point = Panel(a_cgp_2.CurtainGridPanelBasePoint)
panel_orientation_vector = Panel(a_cgp_2.CurtainGridPanelOrientationVector)
panel_symbol = Panel(a_cgp_2.CurtainGridPanelSymbol)
path_mapper_9 = PathMapper([a_cgp_2.IsLockable, a_cgp_2.PanelWidth, a_cgp_2.PanelHeight], source="{A;B;C}(i)", target="{A;B;C;i}")
cset = CreateSet(List=panel_13)  # -> Set, Map
path_mapper_10 = PathMapper([a_cgpt.PanelSystemFamily, a_cgpt.Offset, a_cgpt.Thickness], source="{A;B;C}(i)", target="{A;B;C;i}")
analyze_curtain_system = AnalyzeCurtainSystem(CurtainSystem=elements_5)
a_cst = AnalyzeCurtainSystemType(CurtainSystemType=elementtypes_5)  # -> CurtainPanelType, CurtainGridJoinCondition, Grid1GridLayoutUAxis, Grid1GridSpacingUAxis, Grid1GridAdjustForMullionSizeUAxis, Grid2GridLayoutVAxis, Grid2GridSpacingVAxis, Grid2GridAdjustForMullionSizeVAxis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
analyze_curtain_system_2 = AnalyzeCurtainSystem(CurtainSystem=elements_6)
item = ListItem(List=geometry_4, Index=0, Wrap=True)
grid_insert_geom_2 = CustomPreview(Geometry=geometry_4, Material=ColourSwatch(SwatchColor=RGBA(219, 0, 255, 23)))
grid_insert_types = Panel(cset.Set)
pshift_2 = ShiftPaths(Data=item, Offset=-1)
analyze_curtain_grid_17 = AnalyzeCurtainGrid(CurtainGrid=analyze_curtain_system)  # -> CurtainGridCells, CurtainGridMullions, CurtainGridPanels, CurtainGridLinesAlongUAxis, CurtainGridAngleUAxisGrid1, CurtainGridAlignmentTypeUAxisGrid1, CurtainGridOffsetUAxisGrid1, CurtainGridLinesAlongVAxis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
panel_15 = Panel(analyze_curtain_system_2)
# = Panel System Family
# = Offset
# = Thickness
mullion_type_properties_2 = Panel(path_mapper_10)
panel_centroids = VolumeMoments(Geometry=pshift_2, UseTasks=True)  # -> Volume, Centroid, Inertia, InertiaError, Secondary, SecondaryError, Gyration
panel_16 = Panel(analyze_curtain_grid_17.CurtainGridPanels)
# = Lockable?
# = Width
# = Height
panel_info = Panel(path_mapper_9)
path_mapper_11 = PathMapper(
    [a_cst.Grid1GridLayoutUAxis, a_cst.Grid1GridSpacingUAxis, a_cst.Grid1GridAdjustForMullionSizeUAxis],
    source="{A;B}(i)",
    target="{A;B;i}")
path_mapper_12 = PathMapper(
    [a_cst.Grid2GridLayoutVAxis, a_cst.Grid2GridSpacingVAxis, a_cst.Grid2GridAdjustForMullionSizeVAxis],
    source="{A;B}(i)",
    target="{A;B;i}")
path_mapper_13 = PathMapper(
    [a_cst.Grid1InteriorMullionTypeUAxis, a_cst.Grid1StartMullionTypeUAxisBorder1, a_cst.Grid1EndMullionTypeUAxisBorder2],
    source="{A;B}(i)",
    target="{A;B;i}")
path_mapper_14 = PathMapper(
    [a_cst.Grid2InteriorMullionTypeVAxis, a_cst.Grid2StartMullionTypeVAxisBorder1, a_cst.Grid2EndMullionTypeVAxisBorder2],
    source="{A;B}(i)",
    target="{A;B;i}")
curtain_panel_type_2 = Panel(a_cst.CurtainPanelType)
curtain_join_condition_2 = Panel(a_cst.CurtainGridJoinCondition)
cset_2 = CreateSet(List=panel_14)  # -> Set, Map
panel_17 = Panel(cset_2.Set)
panel_normals = VectorDisplayEx(
    Point=a_cgp_4.CurtainGridPanelBasePoint,
    Vector=a_cgp_4.CurtainGridPanelOrientationVector,
    Colour=ColourSwatch(SwatchColor=RGB(89, 0, 255)),
    Width=1)
panel_normals_2 = VectorDisplayEx(
    Point=panel_centroids.Centroid,
    Vector=a_cgp_4.CurtainGridPanelOrientationVector,
    Colour=ColourSwatch(SwatchColor=RGB(255, 255, 0)),
    Width=1)
u_grid_info_3 = Panel(path_mapper_11)
v_grid_info_3 = Panel(path_mapper_12)
u_mullion_info_2 = Panel(path_mapper_13)
v_mullion_info_2 = Panel(path_mapper_14)
cgjc_2 = CurtainGridJoinCondition({"Not Defined": 0, "Vertical Grid Continuous": 1, "Horizontal Grid Continuous": 2, "Border & Vertical Grid Continuous": 3, "Border & Horizontal Grid Continuous": 4}, selected="Not Defined")
# = Layout
# = Spacing
# = Adjust for Mullion Size
# = Grid 1 Inteiror Mullion Type
# = Start Mullion Type (Border 1)
# = End Mullion Type (Border 2)
# = Grid 2 Inteiror Mullion Type
# = Start Mullion Type (Border 1)
# = End Mullion Type (Border 2)
cgl_3 = CurtainGridLayout({"None": 0, "Fixed Distance": 1, "Fixed Number": 2, "Maximum Spacing": 3, "Minimum Spacing": 4}, selected="None")
# = Layout
# = Spacing
# = Adjust for Mullion Size
cgl_4 = CurtainGridLayout({"None": 0, "Fixed Distance": 1, "Fixed Number": 2, "Maximum Spacing": 3, "Minimum Spacing": 4}, selected="None")
wall_system_family_23 = WallSystemFamily({"Basic": 0, "Curtain": 1, "Stacked": 2}, selected="Curtain")
wall_system_family_24 = WallSystemFamily({"Basic": 0, "Curtain": 1, "Stacked": 2}, selected="Curtain")
wall_system_family_25 = WallSystemFamily({"Basic": 0, "Curtain": 1, "Stacked": 2}, selected="Curtain")
wall_system_family_26 = WallSystemFamily({"Basic": 0, "Curtain": 1, "Stacked": 2}, selected="Curtain")
# GRID LINES
wall_system_family_27 = WallSystemFamily({"Basic": 0, "Curtain": 1, "Stacked": 2}, selected="Curtain")
# GRID LINES - MULLIONS AND PANELS
wall_system_family_28 = WallSystemFamily({"Basic": 0, "Curtain": 1, "Stacked": 2}, selected="Curtain")
walls_23 = DocumentWalls(WallSystemFamily=wall_system_family_23)
walls_24 = DocumentWalls(WallSystemFamily=wall_system_family_24)
walls_25 = DocumentWalls(WallSystemFamily=wall_system_family_25)
walls_26 = DocumentWalls(WallSystemFamily=wall_system_family_26)
walls_27 = DocumentWalls(WallSystemFamily=wall_system_family_27)
walls_28 = DocumentWalls(WallSystemFamily=wall_system_family_28)
analyze_curtain_wall_19 = AnalyzeCurtainWall(CurtainWall=walls_23)  # -> CurtainGrid, HostWall
analyze_curtain_wall_20 = AnalyzeCurtainWall(CurtainWall=walls_24)  # -> CurtainGrid, HostWall
analyze_curtain_wall_21 = AnalyzeCurtainWall(CurtainWall=walls_25)  # -> CurtainGrid, HostWall
analyze_curtain_wall_22 = AnalyzeCurtainWall(CurtainWall=walls_26)  # -> CurtainGrid, HostWall
analyze_curtain_wall_23 = AnalyzeCurtainWall(CurtainWall=walls_27)  # -> CurtainGrid, HostWall
analyze_curtain_wall_24 = AnalyzeCurtainWall(CurtainWall=walls_28)  # -> CurtainGrid, HostWall
analyze_curtain_grid_18 = AnalyzeCurtainGrid(CurtainGrid=analyze_curtain_wall_19.CurtainGrid)  # -> CurtainGridCells, CurtainGridMullions, CurtainGridPanels, CurtainGridLinesAlongUAxis, CurtainGridAngleUAxisGrid1, CurtainGridAlignmentTypeUAxisGrid1, CurtainGridOffsetUAxisGrid1, CurtainGridLinesAlongVAxis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
analyze_curtain_grid_19 = AnalyzeCurtainGrid(CurtainGrid=analyze_curtain_wall_20.CurtainGrid)  # -> CurtainGridCells, CurtainGridMullions, CurtainGridPanels, CurtainGridLinesAlongUAxis, CurtainGridAngleUAxisGrid1, CurtainGridAlignmentTypeUAxisGrid1, CurtainGridOffsetUAxisGrid1, CurtainGridLinesAlongVAxis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
analyze_curtain_grid_20 = AnalyzeCurtainGrid(CurtainGrid=analyze_curtain_wall_21.CurtainGrid)  # -> CurtainGridCells, CurtainGridMullions, CurtainGridPanels, CurtainGridLinesAlongUAxis, CurtainGridAngleUAxisGrid1, CurtainGridAlignmentTypeUAxisGrid1, CurtainGridOffsetUAxisGrid1, CurtainGridLinesAlongVAxis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
analyze_curtain_grid_21 = AnalyzeCurtainGrid(CurtainGrid=analyze_curtain_wall_22.CurtainGrid)  # -> CurtainGridCells, CurtainGridMullions, CurtainGridPanels, CurtainGridLinesAlongUAxis, CurtainGridAngleUAxisGrid1, CurtainGridAlignmentTypeUAxisGrid1, CurtainGridOffsetUAxisGrid1, CurtainGridLinesAlongVAxis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
analyze_curtain_grid_22 = AnalyzeCurtainGrid(CurtainGrid=analyze_curtain_wall_23.CurtainGrid)  # -> CurtainGridCells, CurtainGridMullions, CurtainGridPanels, CurtainGridLinesAlongUAxis, CurtainGridAngleUAxisGrid1, CurtainGridAlignmentTypeUAxisGrid1, CurtainGridOffsetUAxisGrid1, CurtainGridLinesAlongVAxis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
analyze_curtain_grid_23 = AnalyzeCurtainGrid(CurtainGrid=analyze_curtain_wall_24.CurtainGrid)  # -> CurtainGridCells, CurtainGridMullions, CurtainGridPanels, CurtainGridLinesAlongUAxis, CurtainGridAngleUAxisGrid1, CurtainGridAlignmentTypeUAxisGrid1, CurtainGridOffsetUAxisGrid1, CurtainGridLinesAlongVAxis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
a_cgl = AnalyzeCurtainGridLine(CurtainGridLine=analyze_curtain_grid_18.CurtainGridLinesAlongUAxis)  # -> Curve, Segments, ExistingSegments, SkippedSegments, AttachedMullions, AttachedPanels
a_cgl_2 = AnalyzeCurtainGridLine(CurtainGridLine=analyze_curtain_grid_18.CurtainGridLinesAlongVAxis)  # -> Curve, Segments, ExistingSegments, SkippedSegments, AttachedMullions, AttachedPanels
a_cgl_3 = AnalyzeCurtainGridLine(CurtainGridLine=analyze_curtain_grid_19.CurtainGridLinesAlongUAxis)  # -> Curve, Segments, ExistingSegments, SkippedSegments, AttachedMullions, AttachedPanels
a_cgl_4 = AnalyzeCurtainGridLine(CurtainGridLine=analyze_curtain_grid_19.CurtainGridLinesAlongVAxis)  # -> Curve, Segments, ExistingSegments, SkippedSegments, AttachedMullions, AttachedPanels
a_cgl_5 = AnalyzeCurtainGridLine(CurtainGridLine=analyze_curtain_grid_20.CurtainGridLinesAlongUAxis)  # -> Curve, Segments, ExistingSegments, SkippedSegments, AttachedMullions, AttachedPanels
item_2 = ListItem(List=analyze_curtain_grid_21.CurtainGridLinesAlongUAxis, Index=Slider(1, range=0..1), Wrap=True)
item_3 = ListItem(List=analyze_curtain_grid_21.CurtainGridLinesAlongVAxis, Index=Slider(0, range=0..5), Wrap=True)
a_cgl_6 = AnalyzeCurtainGridLine(CurtainGridLine=analyze_curtain_grid_23.CurtainGridLinesAlongUAxis)  # -> Curve, Segments, ExistingSegments, SkippedSegments, AttachedMullions, AttachedPanels
a_cgl_7 = AnalyzeCurtainGridLine(CurtainGridLine=analyze_curtain_grid_23.CurtainGridLinesAlongVAxis)  # -> Curve, Segments, ExistingSegments, SkippedSegments, AttachedMullions, AttachedPanels
crv_2 = Curve(analyze_curtain_grid_22.CurtainGridLinesAlongUAxis)
crv_3 = Curve(analyze_curtain_grid_22.CurtainGridLinesAlongVAxis)
grid_cell_geom_2 = CustomPreview(Geometry=a_cgl.Segments, Material=ColourSwatch(SwatchColor=RGB(255, 255, 255)))
grid_cell_geom_3 = CustomPreview(Geometry=a_cgl_2.Segments, Material=ColourSwatch(SwatchColor=RGB(222, 222, 222)))
grid_cell_geom_4 = CustomPreview(Geometry=a_cgl_3.Curve, Material=ColourSwatch(SwatchColor=RGB(255, 255, 255)))
grid_cell_geom_5 = CustomPreview(Geometry=a_cgl_4.Curve, Material=ColourSwatch(SwatchColor=RGB(222, 222, 222)))
grid_cell_geom_6 = CustomPreview(Geometry=crv_2, Material=ColourSwatch(SwatchColor=RGB(255, 255, 255)))
grid_cell_geom_7 = CustomPreview(Geometry=crv_3, Material=ColourSwatch(SwatchColor=RGB(255, 255, 255)))
a_cgl_8 = AnalyzeCurtainGridLine(CurtainGridLine=item_2)  # -> Curve, Segments, ExistingSegments, SkippedSegments, AttachedMullions, AttachedPanels
a_cgl_9 = AnalyzeCurtainGridLine(CurtainGridLine=item_3)  # -> Curve, Segments, ExistingSegments, SkippedSegments, AttachedMullions, AttachedPanels
mullion_geom = CustomPreview(Geometry=a_cgl_6.Curve, Material=ColourSwatch(SwatchColor=RGB(76, 76, 76)))
geometry_5 = ElementGeometry(Element=a_cgl_6.AttachedMullions)
geometry_6 = ElementGeometry(Element=a_cgl_7.AttachedMullions)
grid_line_curve = Panel(a_cgl_5.Curve)
grid_line_segments = Panel(a_cgl_5.Segments)
kept_line_segments = Panel(a_cgl_5.ExistingSegments)
skipped_line_segments = Panel(a_cgl_5.SkippedSegments)
attached_mullions = Panel(a_cgl_5.AttachedMullions)
attached_panels = Panel(a_cgl_5.AttachedPanels)
mullion_geom_2 = CustomPreview(Geometry=geometry_5, Material=ColourSwatch(SwatchColor=RGBA(0, 111, 255, 23)))
mullion_geom_3 = CustomPreview(Geometry=geometry_6, Material=ColourSwatch(SwatchColor=RGBA(0, 242, 255, 23)))
geometry_7 = ElementGeometry(Element=a_cgl_8.AttachedPanels)
geometry_8 = ElementGeometry(Element=a_cgl_9.AttachedPanels)
mullion_geom_4 = CustomPreview(Geometry=geometry_7, Material=ColourSwatch(SwatchColor=RGBA(221, 0, 255, 23)))
mullion_geom_5 = CustomPreview(Geometry=geometry_8, Material=ColourSwatch(SwatchColor=RGBA(255, 0, 119, 23)))
